# Dynamo graph 00.AUTOMATE_BORING_STUFF.dyn (Dynamo 2.0.2.6826)

# group: INPUT
code_block = CodeBlock { "Automate"; " Boring Stuff"; " With Dynamo"; }

# group: PROCESS
code_block_2 = CodeBlock(What=code_block.out0, Who=code_block.out1, Result=code_block.out2) { What + " the" + Who + Result; }

# group: OUTPUT
watch = Watch(code_block_2)
