# Dynamo graph 02.CREATE_FLOORS_AND_CURTAINWALLS_MULTI_FLOOR.dyn (Dynamo 2.0.2.6826)

# group: INPUT - Floor shape coordinates and Project Families
byCoordinates = Point.ByCoordinates()
number_slider = DoubleSlider(30, range=0..100 step 10)
byCoordinates_2 = Point.ByCoordinates(x=number_slider)
number_slider_2 = DoubleSlider(60, range=0..100 step 10)
byCoordinates_3 = Point.ByCoordinates(x=number_slider, y=number_slider_2)
byCoordinates_4 = Point.ByCoordinates(y=number_slider_2)
categories = Categories(index=248)
all_elements_of_category = ElementsOfCategory(Category=categories)
wall_types = WallTypes(index=0)
floor_types = FloorTypes(index=1)

# group: PROCESS - Modify input attributes
list_create = List.Create(item0=byCoordinates, item1=byCoordinates_2, item2=byCoordinates_3, item3=byCoordinates_4)
boolean = BoolSelector(true)
byPoints = PolyCurve.ByPoints(points=list_create, connectLastToFirst=boolean)
explode = Geometry.Explode(geometry=byPoints)
number = DoubleInput(150)
code_block = CodeBlock(X=all_elements_of_category) { X; }
elevation = Level.Elevation(level=all_elements_of_category)
translate = Geometry.Translate(geometry=byPoints, zTranslation=elevation)

# group: OUTPUT - Create Floors and Walls
byCurveAndHeight = Wall.ByCurveAndHeight(curve=explode, height=number, level=code_block, wallType=wall_types)
watch = Watch(byCurveAndHeight)
byOutlineTypeAndLevel = Floor.ByOutlineTypeAndLevel(outline=translate, floorType=floor_types, level=all_elements_of_category)
watch_2 = Watch(byOutlineTypeAndLevel)
