# Dynamo graph 03.VIEWS_FROM_LEVEL.dyn (Dynamo 2.0.2.6826)

# group: INPUT - Get levels and sort out the Ceiling and Floor plans by level
categories = Categories(index=248)
all_elements_of_category = ElementsOfCategory(Category=categories)
byLevel = CeilingPlanView.ByLevel(level=all_elements_of_category)
byLevel_2 = FloorPlanView.ByLevel(level=all_elements_of_category)
watch = Watch(all_elements_of_category)

# group: PROCESS - Specify values and parameters
string = StringInput("View Template")
view_templates = ViewTemplatesUi(index=1)
string_2 = StringInput("View Template")
view_templates_2 = ViewTemplatesUi(index=3)

# group: OUTPUT - Levels with Templates
setParameterByName = Element.SetParameterByName(element=byLevel, parameterName=string, value=view_templates)
setParameterByName_2 = Element.SetParameterByName(element=byLevel_2, parameterName=string_2, value=view_templates_2)
