# Dynamo graph 04.SHEETS_FROM_EXCEL_05-FIX.dyn (Dynamo 2.0.2.6826)

importExcel = Data.ImportExcel()  # unwired: file, sheetName
file_path = Filename(".\04.TEST_LEVEL_ELEVATION.xlsx")
file_from_path = FileObject(path=file_path)
code_block = CodeBlock { "SHEETS"; }
importExcel_2 = Data.ImportExcel(file=file_from_path, sheetName=code_block)
code_block_2 = CodeBlock { 0; }
removeItemAtIndex = List.RemoveItemAtIndex(list=importExcel_2, indices=code_block_2)
transpose = List.Transpose(lists=removeItemAtIndex)
code_block_3 = CodeBlock { 1; }
getItemAtIndex = List.GetItemAtIndex(list=transpose, index=code_block_3)
code_block_4 = CodeBlock { 0; }
getItemAtIndex_2 = List.GetItemAtIndex(list=transpose, index=code_block_4)
family_types = FamilyTypes(index=23)
view_type = ViewTypesUi(index=9)
getByType = archilab.Revit.Views.Views.GetByType(viewType=view_type)
byNameNumberTitleBlockAndView = Sheet.ByNameNumberTitleBlockAndView(sheetName=getItemAtIndex, sheetNumber=getItemAtIndex_2, titleBlockFamilyType=family_types, view=getByType)  # frozen
watch = Watch(byNameNumberTitleBlockAndView)
views = Views(index=42)
importCSV = Data.ImportCSV(filePath=file_from_path)
byNameNumberTitleBlockAndView_2 = Sheet.ByNameNumberTitleBlockAndView()  # unwired: sheetName, sheetNumber, titleBlockFamilyType, view
family_types_2 = FamilyTypes(index=23)
view_type_2 = ViewTypesUi(index=9)
getByType_2 = archilab.Revit.Views.Views.GetByType(viewType=view_type_2)
categories = Categories(index=602)
all_elements_of_category = ElementsOfCategory(Category=categories)
watch_2 = Watch(all_elements_of_category)
