# Dynamo graph 04.SHEETS_FROM_EXCEL_05.1-GRAPHICS.dyn (Dynamo 2.0.2.6826)

# group: INPUT - Excel sheet with Sheet Number and Names
file_path = Filename("..\..\..\..\..\..\TEST\_DYNAMO_ENVIRONMENT\02.DYNAMO_SCRIPTS\FOR_MWU\TEST_LEVEL_ELEVATION.xlsx")
file_from_path = FileObject(path=file_path)
code_block = CodeBlock { "SHEETS"; }
importExcel = Data.ImportExcel(file=file_from_path, sheetName=code_block)
code_block_2 = CodeBlock { 0; }

# group: PROCESS - Sort the Excel Columns into separate lists for each parameter
removeItemAtIndex = List.RemoveItemAtIndex(list=importExcel, indices=code_block_2)
transpose = List.Transpose(lists=removeItemAtIndex)
code_block_3 = CodeBlock { 1; }
getItemAtIndex = List.GetItemAtIndex(list=transpose, index=code_block_3)
code_block_4 = CodeBlock { 0; }
getItemAtIndex_2 = List.GetItemAtIndex(list=transpose, index=code_block_4)
family_types = FamilyTypes(index=23)
view_type = ViewTypesUi(index=9)
getByType = archilab.Revit.Views.Views.GetByType(viewType=view_type)

# group: OUTPUT - Create sheets based on Excel information, Titelblock family and Floor plan views
byNameNumberTitleBlockAndView = Sheet.ByNameNumberTitleBlockAndView(sheetName=getItemAtIndex, sheetNumber=getItemAtIndex_2, titleBlockFamilyType=family_types, view=getByType)
watch = Watch(byNameNumberTitleBlockAndView)
