# Dynamo graph 05.GRIDS_FROM_CODE_02.dyn (Dynamo 2.0.2.6826)

code_block = CodeBlock { Autodesk.Point.ByCoordinates(1..34..4,70,0); Autodesk.Point.ByCoordinates(1..34..4,-10,0); }
byStartPointEndPoint = Grid.ByStartPointEndPoint(start=code_block.out0, end=code_block.out1)
watch = Watch(byStartPointEndPoint)
code_block_2 = CodeBlock { Autodesk.Point.ByCoordinates(-5,1..60..4,0); Autodesk.Point.ByCoordinates(45,1..60..4,0); }
byStartPointEndPoint_2 = Grid.ByStartPointEndPoint(start=code_block_2.out0, end=code_block_2.out1)
watch_2 = Watch(byStartPointEndPoint_2)
