# Dynamo graph 05.GRIDS_FROM_CODE_03.dyn (Dynamo 2.0.2.6826)

# group: INPUT - Points with ranges
code_block = CodeBlock { Autodesk.Point.ByCoordinates(1..30..10,70,0); Autodesk.Point.ByCoordinates(1..30..10,-10,0); }
code_block_2 = CodeBlock { Autodesk.Point.ByCoordinates(-5,1..60..20,0); Autodesk.Point.ByCoordinates(45,1..60..20,0); }

# group: OUTPUT - Grid lines
byStartPointEndPoint = Grid.ByStartPointEndPoint(start=code_block.out0, end=code_block.out1)
watch = Watch(byStartPointEndPoint)
byStartPointEndPoint_2 = Grid.ByStartPointEndPoint(start=code_block_2.out0, end=code_block_2.out1)
watch_2 = Watch(byStartPointEndPoint_2)
