# Dynamo graph 06.5.COLUMNS_FORM_COORDINATES_CODE.dyn (Dynamo 2.0.2.6826)

# group: INPUT - Coordinates for columns, the column family and the level reference
family_types = FamilyTypes(index=87)
code_block = CodeBlock { 2..60..20; 2..30..10; }
byCoordinates = Point.ByCoordinates(x=code_block.out1, y=code_block.out0, lacing=CrossProduct)
levels = Levels(index=0)

# group: OUTPUT - Columns at coordinates
byPointAndLevel = FamilyInstance.ByPointAndLevel(familyType=family_types, point=byCoordinates, level=levels)
