# Dynamo graph 06.COLUMNS_FROM_GRID_INTERSECT_03.dyn (Dynamo 2.0.2.6826)

categories = Categories(index=233)
all_elements_of_category = ElementsOfCategory(Category=categories)
curve = Grid.Curve(grid=all_elements_of_category)
intersect = Geometry.Intersect(geometry=curve, other=curve, lacing=CrossProduct)
flatten = List.Flatten(list=intersect)
string = StringInput("Point")
removeIfNot = List.RemoveIfNot(list=flatten, type=string)
pruneDuplicates = Point.PruneDuplicates(points=removeIfNot)
family_types = FamilyTypes(index=87)
levels = Levels(index=0)
byPointAndLevel = FamilyInstance.ByPointAndLevel(familyType=family_types, point=flatten, level=levels)
categories_2 = Categories(index=248)
all_elements_of_category_2 = ElementsOfCategory(Category=categories_2)
