# Dynamo graph 08.ROOM_AREA_DELTA_MATH.dyn (Dynamo 2.0.2.6826)

# note: Room Area Delta from Planned
# 2017-12-07 Nick Rozwadowski
# --ROOM PARAMETERS REQUIRED--
# Intended Area SF (Area, Instance)
# AreaDelta (Number, Instance)
# AreaDelta_Date (Text, Instance)
# --PACKAGES REQUIRED--
# None
categories = Categories(index=425)  # graph input
all_elements_of_category = ElementsOfCategory(Category=categories)

# group: FILTER OUT ROOMS WITH BLANK "INTENDED AREA SF"
code_block = CodeBlock { "ROOM-REF-1"; "Area"; ""; }
getParameterValueByName = Element.GetParameterValueByName(element=all_elements_of_category, parameterName=code_block.out0)
ne = getParameterValueByName != code_block.out2
filterByBoolMask = List.FilterByBoolMask(list=all_elements_of_category, mask=ne)

# group: FILTER OUT ROOMS WITH BLANK AREAS
getParameterValueByName_2 = Element.GetParameterValueByName(element=filterByBoolMask.in, parameterName=code_block.out1)
code_block_2 = CodeBlock(X=code_block.out2) { X; }
ne_2 = getParameterValueByName_2 != code_block_2
filterByBoolMask_2 = List.FilterByBoolMask(list=filterByBoolMask.in, mask=ne_2)

code_block_3 = CodeBlock(X=code_block.out0) { X; }
getParameterValueByName_3 = Element.GetParameterValueByName(element=filterByBoolMask_2.in, parameterName=code_block_3)
code_block_4 = CodeBlock(X=code_block.out1) { X; }
getParameterValueByName_4 = Element.GetParameterValueByName(element=filterByBoolMask_2.in, parameterName=code_block_4)
create = List.Create(item0=getParameterValueByName_3, item1=getParameterValueByName_4, item2=filterByBoolMask_2.in)
transpose = List.Transpose(lists=create)
code_block_5 = CodeBlock(X=transpose) { X; }

# group: MATH AND ROUNDING
code_block_6 = CodeBlock { 2; }
code_block_7 = CodeBlock { 0; 1; }
getItemAtIndex = List.GetItemAtIndex(list=transpose@L2, index=code_block_7.out1)
getItemAtIndex_2 = List.GetItemAtIndex(list=transpose@L2, index=code_block_7.out0)
div = getItemAtIndex / getItemAtIndex_2
round = Math.Round(number=div, digits=code_block_6)

getItemAtIndex_3 = List.GetItemAtIndex(list=code_block_5@L2, index=code_block_6)

# group: WRITE PARAMETERS TO ROOMS
code_block_8 = CodeBlock { "ROOM-REF-2"; "ROOM-REF-DATE"; }
setParameterByName = Element.SetParameterByName(element=getItemAtIndex_3, parameterName=code_block_8.out0, value=round)
now = DateTime.Now()
string_from_object = FromObject(obj=now)
setParameterByName_2 = Element.SetParameterByName(element=getItemAtIndex_3, parameterName=code_block_8.out1, value=string_from_object)

watch = Watch(setParameterByName)
