# Dynamo graph DYN_01_STRING_TEST.dyn "DYN_STRING_TEST" (Dynamo 2.3.0.5885)

string = StringInput("This ")
string_2 = StringInput("Script ")
string_3 = StringInput("Works ")
concat = String.Concat(string0=string, string1=string_2, string2=string_3)
watch = Watch(concat)
