# Dynamo graph DYN_02-WRITE-TO-REVIT-ELEMENTS.dyn "DYN_AU-EX-3-WRITE-TO-REVIT-ELEMENTS" (Dynamo 2.3.0.5885)

family_types = FamilyTypes("RPC Male:Alex")
ps_xyz_matrix_family_py = Python(IN[0]=family_types)
# ---------- ps_xyz_matrix_family_py.python (19 lines) ----------
# Enable Python support and load DesignScript library
import clr
clr.AddReference('ProtoGeometry')
from Autodesk.DesignScript.Geometry import *
clr.AddReference('RevitNodes')
from Revit.Elements import *

famtype = IN[0]
pbc = Point.ByCoordinates(0,0,0)
output = []

for x in range(0, 10000, 2000):
	for y in range(0, 10000, 2000):
		for z in range(0, 10000, 2000):
			pbc = Point.ByCoordinates(x,y,z)
			col = FamilyInstance.ByPoint(famtype,pbc)
			output.append(col)

OUT = output
# ----------------------------------------
geometry = Element.Geometry(element=ps_xyz_matrix_family_py)
byPoint = FamilyInstance.ByPoint()  # unwired: familyType, point
string = StringInput("RPC Male")
byName = Family.ByName(name=string)
