# Dynamo graph DYN_03_archilab_floor_area.dyn "DYN_archilab_floor_area" (Dynamo 2.3.0.5885)
# packages: archi-lab.net 2021.25.14

categories = Categories("OST_Floors")
all_elements_of_category = ElementsOfCategory(Category=categories)
area = Custom[Floor.Area](floor=all_elements_of_category)  # package archi-lab.net; This node return floor area.
watch = Watch(area)
